# Grasshopper definition Facade.gh (Grasshopper 1.0.7)
# plug-ins: ggRhinoIFC

gggrasshoppersettings = GgGrasshopperSettings(
    SettingsData_IFCSettings_Format="STEP",
    SettingsData_IFCSettings_GenerateOwnerHistory=True,
    SettingsData_IFCSettings_IdentifyObsolete=True,
    SettingsData_IFCSettings_LastUsedUnits="Feet",
    SettingsData_IFCSettings_Radians=True,
    SettingsData_IFCSettings_RepMapExport="NONE",
    SettingsData_IFCSettings_Target="Universal",
    SettingsData_IFCSettings_VersionIFC="IFC2x3",
    SettingsData_RevitSettings_Format="STEP",
    SettingsData_RevitSettings_GenerateOwnerHistory=True,
    SettingsData_RevitSettings_IdentifyObsolete=True,
    SettingsData_RevitSettings_LastUsedUnits="Feet",
    SettingsData_RevitSettings_Radians=True,
    SettingsData_RevitSettings_RepMapExport="NONE",
    SettingsData_RevitSettings_Target="Universal",
    SettingsData_RevitSettings_VersionIFC="IFC4")
crv = Curve(<curve referenced from the Rhino model>)
offset = OffsetCurve(Curve=crv, Distance=1, Corners=1)
Z = UnitZ(Factor=Slider(158, range=0..200))
extr = Extrude(Base=offset, Direction=Z)
ggifcp = GgIFCProject(Name="My Project")
ggifcs = GgIFCSite(Host=ggifcp, Name="Grasshopper Site", ReferenceElevation=0, Type=2)
ggifcb = GgIFCBuilding(
    ContainerIFCSiteOrBuilding=ggifcs,
    Name="Grasshopper Building",
    LongName="GH Building",
    BuildingComposition=3,
    ElevationOfRefHeight=0,
    ElevationOfTerrain=0)
ggifccwt = GgIFCCurtainWallType(Name="My Type", Tag="001")
ggifccw = GgIFCCurtainWall(IFCHost=ggifcb, IfcCurtainWallType=ggifccwt)
